test file "RiegoTests"

suite "Test de fallo de riego"

  case "Test sin fallo" [baseline]
    model Riego, harness Riego_Harness1
    assessment "Assessment1": At any point of time, if Activacion_riego > 0 becomes true then, with a delay of at most 5, Riego_OK > 0 must be true
      Activacion_riego: signal Riego_Harness1/Input Conversion Subsystem, port 1
      Riego_OK: signal Riego_Harness1/Riego, port 1

  case "Test con fallo" [baseline]
    model Riego, harness Riego_Harness1
    assessment "Assessment1": At any point of time, if Activacion_riego > 0 becomes true then, with a delay of at most 5, Riego_OK < 0.5 must be true
      Activacion_riego: signal Riego/Activacion_riego, port 1
      Riego_OK: signal Riego/Sistema de riego, port 1

suite "Velocidad actuación riego"

  case "Actuación de riego" [baseline]
    model Riego, harness Riego_Harness1
    assessment "Assessment1": At any point of time, if Activacion_riego == 1 becomes true then, with a delay of at most 1, Caudal>0 must be true
      Activacion_riego: signal Riego_Harness1/Input Conversion Subsystem, port 1
      Caudal: signal Riego_Harness1/Riego|Riego/Sistema de riego/Funcion de transferencia de inicio del caudal, port 1