test file "SensoresTests"

suite "Test de los sensores"

  case "Recibir respuesta correcta" [baseline]
    model ObtenerDatosSensores, harness ObtenerDatosSensores_Harness1
    assessment "Assessment1": At any point of time, if obtenerDatos > 0 becomes true then, with a delay of at most 2, datosActualizados > 0 must be true
      obtenerDatos: signal ObtenerDatosSensores_Harness1/Input Conversion Subsystem, port 1
      datosActualizados: signal ObtenerDatosSensores_Harness1/ObtenerDatosSensores, port 5

  case "Velocidad de respuesta" [baseline]
    model ObtenerDatosSensores, harness ObtenerDatosSensores_Harness1
    assessment "Assessment1": At any point of time, if obtenerDatos > 0 becomes true then, with a delay of at most 30e-3, datosActualizados > 0 must be true
      obtenerDatos: signal ObtenerDatosSensores_Harness1/Input Conversion Subsystem, port 1
      datosActualizados: signal ObtenerDatosSensores_Harness1/ObtenerDatosSensores, port 5

  case "Recibir respuesta incorrecta" [baseline]
    model ObtenerDatosSensores, harness ObtenerDatosSensores_Harness1
    assessment "Assessment1": At any point of time, if obtenerDatos > 0 becomes true then, with a delay of at most 2, datosActualizados == 0 must be true
      obtenerDatos: signal ObtenerDatosSensores_Harness1/Input Conversion Subsystem, port 1
      datosActualizados: signal ObtenerDatosSensores_Harness1/ObtenerDatosSensores, port 5