% Requirement links of SensoresTests.mldatx (R2020b)

item 1 verifies Requisitos_Güertito.slreqx#33: RNFD02: Recogida de información de los sensores
item 2 verifies Requisitos_Güertito.slreqx#33: RNFD02: Recogida de información de los sensores
item 3 verifies Requisitos_Güertito.slreqx#33: RNFD02: Recogida de información de los sensores