% Simulink data dictionary Registro_variables.sldd

AccelResSw = mpt.Signal(StorageClass="Global", DataType="boolean", Min=0, Max=1)
Brake = mpt.Signal(StorageClass="Global", DataType="boolean", Min=0, Max=1)
CoastSetSw = mpt.Signal(StorageClass="Global", DataType="boolean", Min=0, Max=1)
CruiseOnOff = mpt.Signal(StorageClass="Global", DataType="boolean", Min=0, Max=1)
Speed = mpt.Signal(StorageClass="Global", DataType="uint8", Min=0, Max=160)
engaged = mpt.Signal(StorageClass="Global", DataType="boolean", Min=0, Max=1)
tspeed = mpt.Signal(StorageClass="Global", DataType="uint8", Min=0, Max=160)
incdec = mpt.Parameter(1, StorageClass="Global", DataType="uint8", Min=1, Max=2)
maxtspeed = mpt.Parameter(90, StorageClass="Global", DataType="uint8", Min=80, Max=90)
mintspeed = mpt.Parameter(20, StorageClass="Global", DataType="uint8", Min=20, Max=25)